# Grasshopper definition Load Combination Generator.gh (Grasshopper 1.0.7)

panel = Panel("""1.0_DL 1.0_SDL
1.2_DL 1.2_SDL 1.0_LL -1.4_Wx 0.85_Th 1.0_PT
1.2_DL 1.2_SDL 1.0_LL 1.4_Wy 0.85_Tc 1.0_PT
1.2_DL 1.2_SDL 1.0_LL -1.4_Wy 0.85_Th 1.0_PT""")
panel_2 = Panel("""DL
SDL
LL
Th
Tc
Wx
Wy
PT""")
python = GhPythonScript(Load_Case_List=panel_2, Load_Combination=panel)  # -> Load_Case_Number, Load_Combination_Factor, Load_Combination_Summary; inputs Load_Case_List: list, Load_Combination: list
# ---------- python: Python ----------
"""This component creates list of load case number and tree of load combination factors for structural anaylsis based on the load case and load combinations defined by user.
Please note that this component will also automatically create load combination for each single load cases and put them in the first n-lines of the output.
Example of these single load cases are: 1.0DL, 1.0LL, and so on. Load combinations defined by user will be added after all the single load cases.
Check the Load_Comb_Summary for the final Load Combination list.
        
    Inputs:
        Load_Case_List: List of Load Cases to be included in the load combination (DL, SDL, etc). This list corresponds to the list in the Load_Combination_Factors.
        Load_Combination: List of Load Combinations to be included in the analysis. Input example: [1.2_DL 1.0_LL 1.4_Wx -0.3Wy 0.85_Tc] <--- type this in a panel without the square bracket, and make sure to add "_" (underscore) symbol between the factor and the loadcase name
    Output:
        Load_Case_Number: List of Load Case Number.
        Load_Combination_Factors: Data tree of Load Factors to be applied to each load case in every combination
        Load_Combination_Summary: List of final Load Combination List
        """
from ghpythonlib.componentbase import executingcomponent as component
import Grasshopper, GhPython
import System
import Rhino
import rhinoscriptsyntax as rs
import ghpythonlib.treehelpers as th

__author__ = "p.eng"
__version__ = "2020.11.25"

class MyComponent(component):
    def RunScript(self, Load_Case_List, Load_Combination):
        def createzerolist(n):
            listofzeros = [0]*n
            return listofzeros
                
        #1. Create Load Combination Based on the Load Case List
        LCNumber = []
        LCFactor = []
        LCSummary = []
        i=0
                
        for loadCase in Load_Case_List:
            LCNumber.append(i)
            i=i+1
            LCSummary.append("1.0"+loadCase)
        for j in range(len(Load_Case_List)):
            #Create list of zeros:
            zerolist = createzerolist(len(Load_Case_List))
            zerolist[j] = 1.0
            LCFactor.append(zerolist)
                    
                
        #2. Create Load Combination Factors based on the Load Combination List
        for loadComb in Load_Combination:
            LCNumber.append(i)
            i=i+1
            loadfactorlist = []
            for loadCase in Load_Case_List:
                #find the location of the load case
                loadCase2 = "_"+loadCase
                index = loadComb.find(loadCase2)
                #find the location of the whitespace
                if index != -1:
                    whitespace = loadComb.rfind(" ",0,index)
                    loadfactor = float(loadComb[whitespace+1:index])
                else:
                    whitespace = -1
                    loadfactor = 0
                loadfactorlist.append(loadfactor)
            LCFactor.append(loadfactorlist)
            loadComb2 = loadComb.replace(" ","+")
            loadComb2 = loadComb2.replace("+-","-")
            loadComb2 = loadComb2.replace("_","")
            LCSummary.append(loadComb2)

        LCFactor = th.list_to_tree(LCFactor,source = [])
        Load_Case_Number = LCNumber
        Load_Combination_Factor = LCFactor
        Load_Combination_Summary = LCSummary
        
        
        # return outputs if you have them; here I try it for you:
        return (Load_Case_Number, Load_Combination_Factor, Load_Combination_Summary)
# ---------- end python ----------
panel_3 = Panel(python.Load_Combination_Summary)
panel_4 = Panel(python.Load_Case_Number)
panel_5 = Panel(python.Load_Combination_Factor)
